# Grasshopper definition FiberwindingExampleDecon.gh (Grasshopper 1.0.7)
# plug-ins: Robots, GeoGrasshopper

curve = Curve(<curve referenced from the Rhino model>)
curve_2 = Curve(<curve referenced from the Rhino model>)

# ----
# Construct Frame
relay = Relay([curve, curve_2])
unit_y = UnitY(Factor=Slider(48, range=0..300))
move = Move(Geometry=relay, Motion=unit_y)  # -> graft(Geometry), Transform
data = Data(graft(relay))
unit_z = UnitZ(Factor=Slider(25, range=0..100))
ruled_surface = RuledSurface(CurveA=move.Geometry, CurveB=data)
extrude = Extrude(Base=ruled_surface, Direction=unit_z)
move_2 = Move(Geometry=extrude, Motion=expr("-x/2", unit_z))  # -> Geometry, Transform
custom_preview = CustomPreview(Geometry=move_2.Geometry, Material=ColourSwatch(SwatchColor=RGB(95, 212, 212)))

# ----
# Distance from Edge
number_slider = Slider(0.03, range=0..0.1)
construct_domain = ConstructDomain(DomainStart=number_slider, DomainEnd=expr("1-x", number_slider))

# ----
# Pins
number_slider_2 = Slider(18, range=0..100)
range = Range(Domain=construct_domain, Steps=number_slider_2)
construct_point = ConstructPoint(XCoordinate=" 0.5", YCoordinate=range, ZCoordinate=0)

# ----
# Select Frame Face
face = Slider(3, range=0..10)
deconstruct_brep = DeconstructBrep(Brep=move_2.Geometry)  # -> Faces, Edges, Vertices
list_item = ListItem(List=deconstruct_brep.Faces, Index=face, Wrap=True)

# ----
# Weaving
evaluate_surface = EvaluateSurface(Surface=reparameterize(list_item), Point=construct_point)  # -> Point, Normal, UDirection, VDirection, Frame
plane_normal = PlaneNormal(Origin=evaluate_surface.Point, ZAxis=expr("-x", evaluate_surface.Normal))
explode_tree = ExplodeTree(Data=plane_normal)  # -> Branch0, Branch1
panel = Panel("""0
1""")
weave = Weave(Pattern=panel, Stream0=explode_tree.Branch0, Stream1=explode_tree.Branch1, NullGaps=False)
unit_y_2 = UnitY(Factor=Slider(3, range=0..100))
reverse_list = ReverseList(List=weave)
move_3 = Move(Geometry=reverse_list, Motion=expr("-x", unit_y_2))  # -> Geometry, Transform

plane = Plane(move_3.Geometry)

# ----
# Start/ Endpoints
point = Point(Point(575.8427598, 757.1672165, 144.4882915))
point_2 = Point(Point(-525.7550932, 670.6444686, 178.6938115))

# ----
# Fiber Winder
alignaxis = ValueList({"None": 0, "X": 1, "Y": 2}, selected="None")
pinsize = Slider(40, range=0..100)
index = Slider(28, range=0..100)
toolrotation = Slider(-101, range=-180..180)
fiber_winder = FiberWinder(
    WeavingPlanes=plane,
    StartPoint=point,
    EndPoint=point_2,
    Index=index,
    PinSize=pinsize,
    FiberMulti=0,
    BendingMulti=Slider(0, range=0..1),
    BendingDistance=Slider(0.6, range=0..1),
    MarkerSize=Slider(25, range=0..1000),
    AlignAxis=alignaxis,
    ToolRotation=toolrotation)  # -> FiberWinding, StreamGeometry, StreamSettings, RobotPlanes

# ----
# Deconstruct Fiberwinding
deconstruct_fiberwinding = DeconstructFiberWinding(FiberWinding=fiber_winder.FiberWinding)  # -> WeavingPlanes, ArcPLanes, Bendingplanes, StartPlane, EndPlane

data_2 = Data(deconstruct_fiberwinding.EndPlane)

# ----
# Extend Arcs
extend = Slider(30, range=0..100)
interpolate = Interpolate(Vertices=deconstruct_fiberwinding.ArcPLanes, Degree=3, Periodic=False, KnotStyle=1)  # -> Curve, Length, Domain
extend_curve = ExtendCurve(Curve=interpolate.Curve, Type=0, Start=extend, End=extend)  # -> flatten(Curve)
divide_curve = DivideCurve(Curve=extend_curve, Count=10, Kinks=False)  # -> simplify(Points), Tangents, Parameters
deconstruct_plane = DeconstructPlane(Plane=deconstruct_fiberwinding.WeavingPlanes)  # -> Origin, graft(XAxis), graft(YAxis), ZAxis
construct_plane = ConstructPlane(Origin=divide_curve.Points, XAxis=deconstruct_plane.XAxis, YAxis=deconstruct_plane.YAxis)  # -> simplify(Plane)
rotate_plane = RotatePlane(Plane=construct_plane, Angle=degrees(Slider(180, range=0..1000)))

# ----
# Change Start/EndPlane
flip_plane = FlipPlane(Plane=deconstruct_fiberwinding.StartPlane, ReverseX=False, ReverseY=False, SwapAxes=True)
flip_plane_2 = FlipPlane(Plane=deconstruct_fiberwinding.EndPlane, ReverseX=False, ReverseY=False, SwapAxes=True)

# ----
# Change Orientation
# Bottom Row Arcs
panel_2 = Panel("{0,2,...}")
split_tree = SplitTree(Data=rotate_plane, Masks=flatten(panel_2))  # -> Positive, Negative
deconstruct_plane_2 = DeconstructPlane(Plane=split_tree.Positive)  # -> Origin, XAxis, YAxis, ZAxis
rotate_3d = Rotate3D(
    Geometry=split_tree.Positive,
    Angle=degrees(Slider(20, range=0..360)),
    Center=deconstruct_plane_2.Origin,
    Axis=deconstruct_plane_2.XAxis)  # -> Geometry, Transform
merge = Merge(Data1=rotate_3d.Geometry, Data2=split_tree.Negative)

# ----
# Bending Curves
curve_3 = Curve(<curve referenced from the Rhino model>)
curve_4 = Curve(<curve referenced from the Rhino model>)
list_length = ListLength(List=deconstruct_fiberwinding.WeavingPlanes)  # -> expr("x-2", Length)
merge_2 = Merge(Data1=curve_4, Data2=curve_3)
divide_curve_2 = DivideCurve(Curve=merge_2, Count=list_length, Kinks=False)  # -> Points, Tangents, Parameters
flip_matrix = FlipMatrix(Data=divide_curve_2.Points)  # -> simplify(Data)
split_tree_2 = SplitTree(Data=flip_matrix, Masks=flatten("{0,2,...}"))  # -> Positive, Negative
reverse_list_2 = ReverseList(List=split_tree_2.Negative)
merge_3 = Merge(Data1=split_tree_2.Positive, Data2=reverse_list_2)
xz_plane = XZPlane(Origin=merge_3)
rotate_plane_2 = RotatePlane(Plane=xz_plane, Angle=degrees(Slider(90, range=0..1000)))
flip_plane_3 = FlipPlane(Plane=rotate_plane_2, ReverseX=False, ReverseY=False, SwapAxes=True)

# ----
# Construct Fiberwinding
construct_fiberwinding = ConstructFiberWinding(
    WeavingPlanes=deconstruct_fiberwinding.WeavingPlanes,
    ArcPlanes=merge,
    Bendingplanes=flip_plane_3,
    StartPlane=flip_plane,
    EndPlane=flip_plane_2)

# ----
# Tool Definition
# n
n = Slider(115, range=0..130)
endeffektor = Mesh(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)
c_gettcp = CSharpScript(mesh=endeffektor, n=n)  # -> TCP, MeshNozzle; inputs mesh: Mesh, n: Double
# ---------- c_gettcp: C# ----------
    BoundingBox bBox = mesh.GetBoundingBox(false);

    double height = 164 + n;

    Cylinder c = new Cylinder(new Circle(new Point3d(0, 0, 93.25), 5.25), height);
    Mesh mC = Mesh.CreateFromCylinder(c, 1, 8);

    mC.Append(mesh);

    TCP = new Plane(new Point3d(0, 0, 257.25 + n), Vector3d.ZAxis);
    MeshNozzle = mC;
# ---------- end c_gettcp ----------
create_tool = CreateTool(ExtruderLance="windingTool", TCP=c_gettcp.TCP, Weight=0, Mesh=c_gettcp.MeshNozzle)  # -> Tool, TCP

# ----
# Speed
speed = Slider(3000, range=300..10000)

# ----
# Robot System
value_list = ValueList({"UR 10 Tisch": 0, "UR 5 Tisch": 1, "UR 5 Tisch außen": 2}, selected="UR 10 Tisch")
c_robotpos = CSharpScript(UR=value_list, TooltipTextOverride="Author: Leon Brohmann")  # -> Name, BasePlane, IpAddress; inputs UR: Int32
# ---------- c_robotpos: C# ----------
    string name;
    Point3d pos;
    string ipAddress;

    switch (UR)
    {
      default:
        name = "ITE-UR10";
        ipAddress = "192.168.1.201";
        pos = Point3d.Origin;
        break;

      case 1:
        name = "ITE-UR5";
        ipAddress = "192.168.1.202";
        pos = new Point3d(0, 1110, 0);
        break;

      case 2:
        name = "ITE-UR5";
        ipAddress = "192.168.1.202";
        pos = new Point3d(0, 1700, 0);
        break;
    }

    Name = name;
    BasePlane = new Plane(pos, Vector3d.ZAxis);
    IpAddress = ipAddress;
# ---------- end c_robotpos ----------
load_robot_system = LoadRobotSystem(Name=c_robotpos.Name, Base=c_robotpos.BasePlane)

# ----
# Roboter Target
flag_fields = FlagFields({"Shoulder": 1, "Elbow": 2, "Wrist": 4}, selected="Wrist")
value_list_2 = ValueList({"Joint", "Linear"}, selected="Linear")
create_target = CreateTarget(
    Plane=construct_fiberwinding,
    RobConf=flag_fields,
    Motion=value_list_2,
    Tool=create_tool.Tool,
    Speed=speed,
    IsCartesian=True)

# ----
# Create Roboter Programm
create_program = CreateProgram(Name="DefaultProgram", RobotSystem=load_robot_system, Targets1=create_target, StepSize=1, URHomingSpeed=25)  # -> Program, Code, Duration, Warnings, Errors, Arrays

# ----
# UR Control
play = Button()
remote_ur = RemoteUR(Program=create_program.Program, IP=c_robotpos.IpAddress, Upload=False, Play=play, Pause=False)

# ----
# Robot Preview
control_knob = ControlKnob(Decimals=3, Limit=True, Maximum=1, Minimum=0, Range=1, Value=0)
program_simulation = ProgramSimulation(Program=create_program.Program, Time=control_knob, Normalized=True)  # -> SystemMeshes, JointRotations, Plane, Index, Time, Program, Errors
C = ColourSwatch(SwatchColor=RGB(227, 227, 227))
custom_preview_2 = CustomPreview(Geometry=program_simulation.SystemMeshes, Material=C)

# ----
# Roboter Path Preview
polyline = PolyLine(Vertices=construct_fiberwinding, Closed=False)  # -> reparameterize(Polyline)
c_preview = CSharpScript(index=program_simulation.Index, simPlanes=program_simulation.Plane, pLine=polyline, width=Slider(2, range=0..10))  # inputs index: Int32, simPlanes: list of Plane, pLine: Curve, width: Int32
# ---------- c_preview: C# ----------
    preview = null;
    _width = width;

    Point3d testPoint = simPlanes[7].Origin;

    double t = 0;
    pLine.ClosestPoint(testPoint, out t);

    if (t == 0)
      return;

    if (t == 1)
    {
      preview = pLine;
      return;
    }

    Curve[] crvs = pLine.Split(t);

    if (crvs == null || crvs.Length < 1)
      return;

    preview = crvs[0];
# ---------- c_preview: C# additional code ----------
  Curve preview;
  int _width;

  public override void DrawViewportMeshes(IGH_PreviewArgs args)
  {
    if (preview != null)
      args.Display.DrawCurve(preview, System.Drawing.Color.Black, _width);

  }
# ---------- end c_preview ----------

# ----
# Table
arbeitstisch = Mesh([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])
C_2 = ColourSwatch(SwatchColor=RGB(176, 176, 176))
custom_preview_3 = CustomPreview(Geometry=arbeitstisch, Material=C_2)
