# Grasshopper definition DBFS_GHCourse.gh (Grasshopper 1.0.7)

# Attractors
# Attactor Example 1
number_slider = Slider(150, range=0..500)
number_slider_2 = Slider(2, range=1..100)

# ----
# Attractor points
point = Point([<point referenced from the Rhino model> x2])

# ----
# Path Example 1
# Geometry
curveup = Curve(<curve referenced from the Rhino model>)
curvedown = Curve(<curve referenced from the Rhino model>)

division_horizontal = Slider(3, range=1..100)
offset_distance = Slider(5, range=0..10)
division_vertical = Slider(3, range=1..200)

# ----
# Path Example 3
# Geometry
curve = Curve(<curve referenced from the Rhino model>)
curve_2 = Curve(<curve referenced from the Rhino model>)
curve_3 = Curve(<curve referenced from the Rhino model>)
curve_4 = Curve(<curve referenced from the Rhino model>)

division_vertical_2 = Slider(6, range=2..100)
division_horizontal_2 = Slider(4, range=2..100)
element_count = Slider(2, range=1..10)
# Attactor Example 2
point_2 = Point([<point referenced from the Rhino model> x3])
curve_5 = Curve(<curve referenced from the Rhino model>)
u_count = Slider(32, range=0..40)
curve_6 = Curve(<curve referenced from the Rhino model>)
v_count = Slider(5, range=0..40)
z_length = Slider(3, range=0..10)

# ----
# Attractor points
point_3 = Point([<point referenced from the Rhino model> x3])

x = Slider(20, range=0..100)
y = Slider(20, range=0..100)
# Attactor Example 3
x_pos = Slider(220, range=0..400)

# ----
# Min and Max Extrusion HeigthHeight
extrusion_h_min = Slider(4.091, range=0..50)
extrusion_h_max = Slider(20.217, range=0..50)

# ----
# Attactor Example 4
offset_distance_2 = Slider(0, range=-11..0)
x_2 = Slider(250, range=0..300)
curve_7 = Curve(<curve referenced from the Rhino model>)
hexsize = Slider(1, range=1..100)
x_3 = Slider(12, range=0..20)
y_2 = Slider(12, range=0..20)
curve_8 = Curve([<curve referenced from the Rhino model> x3])
number_slider_3 = Slider(3254, range=0..5000)
curve_9 = Curve(<curve referenced from the Rhino model>)
curve_10 = Curve([<curve referenced from the Rhino model> x3])
curves = Relay([curve_6, curve_5])
loft = Loft(Curves=curve_8, Options={Adjust=False, Closed=False, LoftEnds=0, LoftSimp=0, LoftType=0, Rebuild=10, Refit=0.01})
loft_2 = Loft(Curves=curve_10, Options={Adjust=False, Closed=False, LoftEnds=0, LoftSimp=0, LoftType=0, Rebuild=10, Refit=0.01})
# Attactor Example 5
number_slider_4 = Slider(280, range=0..400)
number_slider_5 = Slider(1000, range=0..1000)
# Attactor Example 6
number_slider_6 = Slider(9, range=0..10)

# ----
# Construct Grid
construct_point = ConstructPoint(XCoordinate=number_slider, YCoordinate=0, ZCoordinate=0)
rectangular = Rectangular(
    Plane=construct_point,
    SizeX=number_slider_2,
    SizeY=number_slider_2,
    ExtentX=Slider(10, range=0..10),
    ExtentY=Slider(10, range=0..10))  # -> Cells, flatten(Points)

construct_point_2 = ConstructPoint(XCoordinate=x_pos, YCoordinate=0, ZCoordinate=0)

# ----
# Creates Curves between Curves
series = Series(Start=0, Step=expr("1/x", division_horizontal), Count=expr("x+1", division_horizontal))
tween_curve = TweenCurve(CurveA=curvedown, CurveB=curveup, Factor=series, BlendType=0)  # -> simplify(graft(Tween))

# ----
# Create Hexagon Grid
construct_point_3 = ConstructPoint(XCoordinate=x_2, YCoordinate=0, ZCoordinate=0)
hexagonal = Hexagonal(Plane=construct_point_3, Size=hexsize, ExtentX=x_3, ExtentY=y_2)  # -> Cells, Points

# ----
# Path Example 2
number_slider_7 = Slider(15, range=0..80)

# ----
# Maximum circle size
panel = Panel("2")
division = Division(A=number_slider_2, B=panel)
maximum_circle_size = Panel(division)

brep_join = BrepJoin(Breps=[loft_2, loft])  # -> Breps, Closed
construct_point_4 = ConstructPoint(XCoordinate=number_slider_4, YCoordinate=0, ZCoordinate=0)
loft_3 = Loft(Curves=curves, Options={Adjust=False, Closed=False, LoftEnds=0, LoftSimp=0, LoftType=0, Rebuild=10, Refit=0.01})
rectangle = Rectangle(Plane=construct_point_2, XSize=x, YSize=y, Radius=0)  # -> Rectangle, Length
minimum_circle_size = Slider(0.1, range=0.1..1)
divide_surface = DivideSurface(Surface=loft_3, UCount=u_count, VCount=v_count)  # -> Points, Normals, Parameters

# ----
# Data after tween
# Construct LineGrid
# Data after
# second tween
# After Graft
series_2 = Series(Start=0, Step=expr("1/x", division_horizontal_2), Count=expr("x+1", division_horizontal_2))
series_3 = Series(Start=0, Step=expr("1/x", division_vertical_2), Count=expr("x+1", division_vertical_2))
tween_curve_2 = TweenCurve(CurveA=curve, CurveB=curve_2, Factor=series_3, BlendType=0)
tween_curve_3 = TweenCurve(CurveA=curve_3, CurveB=curve_4, Factor=series_3, BlendType=0)
data = Data(graft(tween_curve_2))
data_2 = Data(graft(tween_curve_3))
param_viewer = ParamViewer(tween_curve_2)
param_viewer_2 = ParamViewer(data)
tween_curve_4 = TweenCurve(CurveA=data, CurveB=data_2, Factor=series_2, BlendType=0)  # -> simplify(Tween)
param_viewer_3 = ParamViewer(tween_curve_4)

# ----
# Average distance
# attractor to point
pull_point = PullPoint(Point=rectangular.Points, Geometry=point, ClosestOnly=True)  # -> ClosestPoint, Distance

rectangle_2 = Rectangle(Plane=construct_point_4, XSize=Slider(15, range=0..20), YSize=Slider(15, range=0..20), Radius=0)  # -> Rectangle, Length

# ----
# Creates a random amout
# of points in a region
populate_2d = Populate2D(Region=rectangle.Rectangle, Count=Slider(208, range=0..500), Seed=Slider(11, range=0..100))

# ----
# Offset Curves
offset_curve = OffsetCurve(Curve=tween_curve, Distance=expr("-x", offset_distance), Plane=PlaneXY(0, 0, 0), Corners=1)  # -> simplify(Curve)

panel_2 = Panel("""1
0""")
bounding_box = BoundingBox(Content=brep_join.Breps, Plane=PlaneXY(0, 0, 0))  # -> Box, Box_2
crv = Curve(reparameterize(<curve referenced from the Rhino model>))
crv_2 = Curve(reparameterize(<curve referenced from the Rhino model>))
crv_3 = Curve(reparameterize(<curve referenced from the Rhino model>))
multiplication = Multiplication(A=divide_surface.Normals, B=z_length)
area = Area(Geometry=hexagonal.Cells)  # -> Area, flatten(Centroid)
offset_curve_2 = OffsetCurve(Curve=hexagonal.Cells, Distance=offset_distance_2, Plane=PlaneXY(0, 0, 0), Corners=1)  # -> simplify(flatten(Curve))
series_4 = Series(Start=0, Step=expr("1/(x)", number_slider_7), Count=number_slider_7)
populate_2d_2 = Populate2D(Region=rectangle_2.Rectangle, Count=number_slider_5, Seed=1)
random = Random(Range=Domain(0, 1), Number=number_slider_5, Seed=number_slider_6)
deconstruct_box = DeconstructBox(Box=bounding_box.Box_2)  # -> Plane, X, Y, Z

# ----
# Remap distance for right circle size
bounds = Bounds(Numbers=pull_point.Distance)
construct_domain = ConstructDomain(DomainStart=minimum_circle_size, DomainEnd=maximum_circle_size)
remap_numbers = RemapNumbers(Value=pull_point.Distance, Source=bounds, Target=construct_domain)  # -> Mapped, Clipped
graph_mapper = GraphMapper(
    remap_numbers.Mapped,
    x0=0,
    x1=1,
    y0=0,
    y1=1,
    container_name="Bezier",
    cpx=[0, 0.4164296091, 0.5391916633, 1],
    cpy=[0, 0.1432273984, 0.8934394717, 1])
remap_numbers_2 = RemapNumbers(Value=graph_mapper, Source=Domain(0, 1), Target=construct_domain)  # -> Mapped, Clipped

move = Move(Geometry=divide_surface.Points, Motion=expr("-x", multiplication))  # -> flatten(Geometry), Transform
data_3 = Data(flatten(divide_surface.Points))
min_size = Slider(0.1, range=0..0.1)

# ----
# Creates a
# voronoi structure
voronoi = Voronoi(Points=populate_2d, Boundary=rectangle.Rectangle, BruteForceOverride=False)

pull_point_2 = PullPoint(Point=populate_2d, Geometry=point_3, ClosestOnly=True)  # -> ClosestPoint, Distance
curve_closest_point = CurveClosestPoint(Point=area.Centroid, Curve=curve_7)  # -> Point, Parameter, Distance
deconstruct_domain = DeconstructDomain(Domain=deconstruct_box.Z)  # -> Start, expr("X*4", End)

# ----
# Grasshopper Pathmaking Tutorial v1.0 - SoSe 19
# Autor: M.Sc. Arch Leon Brohmann
# leon.brohmann@tu-braunschweig.de
# Create Points
# PointsB
# PointsA
# PointsA
# PointsB
divide_curve = DivideCurve(Curve=tween_curve, Count=division_vertical, Kinks=False)  # -> simplify(Points), Tangents, Parameters
divide_curve_2 = DivideCurve(Curve=offset_curve, Count=division_vertical, Kinks=False)  # -> simplify(Points), Tangents, Parameters

deconstruct = Deconstruct(Point=populate_2d_2)  # -> XComponent, YComponent, ZComponent
merge = Merge(Data1=data_3, Data2=move.Geometry)
attractor_multiplicator = Slider(5, range=0..10)
construct_domain_2 = ConstructDomain(DomainStart=min_size, DomainEnd=1)

# ----
# Fiberwinding
hframe = HorizontalFrame(Curve=crv, Parameter=series_4)
hframe_2 = HorizontalFrame(Curve=crv_2, Parameter=series_4)
hframe_3 = HorizontalFrame(Curve=crv_3, Parameter=series_4)
weave = Weave(Pattern=panel_2, Stream0=hframe, Stream1=hframe_2, NullGaps=False)
weave_2 = Weave(Pattern=panel_2, Stream0=hframe_3, Stream1=hframe_2, NullGaps=False)
merge_2 = Merge(Data1=weave_2, Data2=weave)
deplane = DeconstructPlane(Plane=merge_2)  # -> Origin, XAxis, YAxis, ZAxis
multiplication_2 = Multiplication(A=deplane.YAxis, B=-1)
pt = Point(<point referenced from the Rhino model>)
pt_2 = Point(<point referenced from the Rhino model>)
c_script = CSharpScript(
    weavingPoints=deplane.Origin,
    startPoint=pt,
    endPoint=pt_2,
    normals=multiplication_2,
    Idx=Slider(41, range=-1..50),
    PinSize=Slider(0.269, range=0..1))  # -> out, PreviewPath, PreviewPlanes; inputs weavingPoints: list of Point3d, startPoint: Point3d, endPoint: Point3d, normals: list of Vector3d, Idx: Int32, PinSize: Double
# ---------- c_script: C# ----------
    int ptCount = weavingPoints.Count;

    List<NurbsCurve> testList = new List<NurbsCurve>();
    List<Plane> previewPlanes = new List<Plane>();

    if (ptCount < 1)
      return;

    if(normals.Count == 0)
    {
      for (int i = 0; i < ptCount; i++)
        normals.Add(Vector3d.ZAxis);
    }

    double radius = (PinSize <= 0) ? 0.01 : PinSize / 2.00;

    //GetArcParameters
    double[] arcT = new double[4];
    for (int i = 0; i < 4; i++)
      arcT[i] = 1.00 / 3.00 * i;

    for (int i = 0; i < ptCount; i++)
    {
      Point3d actualPt = weavingPoints[i];
      Point3d prevPt;

      if (i > 1 && i < ptCount )
        prevPt = weavingPoints[i - 1];
      else
      {
        prevPt = startPoint;
      }

      Point3d nextPt;
      if (i < ptCount - 1)
        nextPt = weavingPoints[i + 1];
      else
        nextPt = endPoint;

      Plane pCross = new Plane(actualPt, actualPt - prevPt, actualPt - nextPt);

      Vector3d norm = normals[i];


      bool isFlipped = Vector3d.Multiply(norm, pCross.Normal) < 0;



      if (isFlipped)
        norm = -norm;

      Plane normalPlane = new Plane(actualPt, norm);

      if (i < ptCount)
      {
        Circle nMCircle = new Circle(normalPlane, radius);

        var planeRev = nMCircle.Plane;
        var trans = Rhino.Geometry.Transform.PlaneToPlane(planeRev, Plane.WorldXY);

        nMCircle.Transform(trans);

        Point3d ptA = GetTangentialPoint(trans, prevPt, nMCircle, pCross, false);
        Point3d ptB = GetTangentialPoint(trans, nextPt, nMCircle, pCross, true);

        Transform transRev = Rhino.Geometry.Transform.PlaneToPlane(Plane.WorldXY, planeRev);


        NurbsCurve arc = DrawArcCurve(ptA, ptB, nMCircle);

        arc.Transform(transRev);
        arc.Domain = new Interval(0, 1);

        Point3d pt1;
        NurbsCurve c;

        if (i > 0)
        {
          c = testList[testList.Count - 1];
          pt1 = c.Points[0].Location;
        }else
        {
          pt1 = startPoint;
        }

        var pt2 = arc.Points[arc.Points.Count - 1].Location;

        Line ln = new Line(pt1, pt2);
        testList.Add(ln.ToNurbsCurve());

        if (i == ptCount - 1)
        {
          var pt3 = arc.Points[0].Location;
          ln = new Line(pt3, endPoint);
          testList.Add(ln.ToNurbsCurve());
        }

        testList.Add(arc);

        Plane[] frames = arc.GetPerpendicularFrames(arcT);

        if(isFlipped)
          for (int u = 0; u < frames.Length; u++)
          {
            Plane f = frames[u];
            f.Rotate(Math.PI, f.ZAxis);

            frames[u] = f;
          }

        previewPlanes.AddRange(frames);;
      }
    }

    PreviewPath = testList;
    PreviewPlanes = previewPlanes;
# ---------- c_script: C# additional code ----------
  public NurbsCurve DrawArcCurve(Point3d a, Point3d b, Circle circle)
  {
    double param;
    circle.ClosestParameter(b, out param);
    var tan = circle.TangentAt(param);

    return  (new Arc(b, tan, a)).ToNurbsCurve();
  }

  public Point3d GetTangentialPoint(Transform trans, Point3d next, Circle c, Plane plane, bool reverse)
  {
    next.Transform(trans);

    Point3d pt1;
    Point3d pt2;

    bool success = FindTangents(c.Plane, c.Center, c.Radius, next, out  pt1, out  pt2);

    if (success)
      return (reverse) ? pt2 : pt1;

    return new Point3d();
  }

  // <Custom additional code>
  // Find the tangent points for this circle and external point.
  // Return true if we find the tangents, false if the point is
  // inside the circle.
  private bool FindTangents(Plane plane, Point3d center, double radius,
    Point3d external_point, out Point3d pt1, out Point3d pt2)
  {
    // Find the distance squared from the
    // external point to the circle's center.
    double dx = center.X - external_point.X;
    double dy = center.Y - external_point.Y;

    double D_squared = dx * dx + dy * dy;

    if (D_squared < radius * radius)
    {
      pt1 = new Point3d(-1, -1, 0);
      pt2 = new Point3d(-1, -1, 0);
      return false;
    }

    // Find the distance from the external point
    // to the tangent points.
    double L = Math.Sqrt(D_squared - radius * radius);

    // Find the points of intersection between
    // the original circle and the circle with
    // center external_point and radius dist.
    FindCircleCircleIntersections(
      center.X, center.Y, radius,
      external_point.X, external_point.Y, L,
      out pt1, out pt2);

    //    pt1.Z = center.Z;
    //       pt2.Z = center.Z;

    return true;
  }

  // Find the points where the two circles intersect.
  private int FindCircleCircleIntersections(
    double cx0, double cy0, double radius0,
    double cx1, double cy1, double radius1,
    out Point3d intersection1, out Point3d intersection2)
  {
    // Find the distance between the centers.
    double dx = cx0 - cx1;
    double dy = cy0 - cy1;
    double dist = Math.Sqrt(dx * dx + dy * dy);

    // See how many solutions there are.
    if (dist > radius0 + radius1)
    {
      // No solutions, the circles are too far apart.
      intersection1 = new Point3d(0, 0, 0);
      intersection2 = new Point3d(0, 0, 0);
      return 0;
    }
    else if (dist < Math.Abs(radius0 - radius1))
    {
      // No solutions, one circle contains the other.
      intersection1 = new Point3d(0, 0, 0);
      intersection2 = new Point3d(0, 0, 0);
      return 0;
    }
    else if ((dist == 0) && (radius0 == radius1))
    {
      // No solutions, the circles coincide.
      intersection1 = new Point3d(0, 0, 0);
      intersection2 = new Point3d(0, 0, 0);
      return 0;
    }
    else
    {
      // Find a and h.
      double a = (radius0 * radius0 -
        radius1 * radius1 + dist * dist) / (2 * dist);
      double h = Math.Sqrt(radius0 * radius0 - a * a);

      // Find P2.
      double cx2 = cx0 + a * (cx1 - cx0) / dist;
      double cy2 = cy0 + a * (cy1 - cy0) / dist;

      // Get the points P3.
      intersection1 = new Point3d(
        (double) (cx2 + h * (cy1 - cy0) / dist),
        (double) (cy2 - h * (cx1 - cx0) / dist), 0);
      intersection2 = new Point3d(
        (double) (cx2 - h * (cy1 - cy0) / dist),
        (double) (cy2 + h * (cx1 - cx0) / dist), 0);

      // See if we have 1 or 2 solutions.
      if (dist == radius0 + radius1) return 1;
      return 2;
    }
  }
# ---------- end c_script ----------
Y = UnitY(Factor=Slider(14, range=0..50))
pipe = Pipe(Curve=c_script.PreviewPath, Radius=Slider(0.04, range=0..1), Caps=0)
preview = CustomPreview(Geometry=pipe, Material=ColourSwatch(SwatchColor=RGB(0, 191, 255)))

bounds_2 = Bounds(Numbers=curve_closest_point.Distance)
construct_domain_3 = ConstructDomain(DomainStart=deconstruct_domain.Start, DomainEnd=deconstruct_domain.End)
construct_domain_4 = ConstructDomain(DomainStart=extrusion_h_min, DomainEnd=extrusion_h_max)
bounds_3 = Bounds(Numbers=flatten(pull_point_2.Distance))

# ----
# Creates a
# Surface
boundary_surfaces = BoundarySurfaces(Edges=voronoi)

bounds_4 = Bounds(Numbers=deconstruct.XComponent)
point_4 = Point(simplify(graft(merge)))
remap_numbers_3 = RemapNumbers(Value=curve_closest_point.Distance, Source=bounds_2, Target=construct_domain_2)  # -> Mapped, Clipped
domain_box = DomainBox(Base=PlaneXY(0, 0, 0), X=deconstruct_box.X, Y=deconstruct_box.Y, Z=construct_domain_3)
remap_numbers_4 = RemapNumbers(Value=pull_point_2.Distance, Source=bounds_3, Target=construct_domain_4)  # -> Mapped, Clipped
remap_numbers_5 = RemapNumbers(Value=deconstruct.XComponent, Source=bounds_4, Target=Domain(0, 1))  # -> Mapped, Clipped
construct_domain_5 = ConstructDomain(DomainStart=Slider(0, range=0..100), DomainEnd=Slider(19, range=0..100))
vector_2pt = Vector2Pt(PointA=point_2, PointB=point_4, Unitize=False)  # -> Vector, Length
populate_3d = Populate3D(Region=domain_box, Count=number_slider_3, Seed=Slider(6, range=0..10))
graph_mapper_2 = GraphMapper(
    remap_numbers_3.Mapped,
    x0=0,
    x1=1,
    y0=0,
    y1=1,
    container_name="Bezier",
    cpx=[0, 0.2710146606, 0.9034786224, 1],
    cpy=[0, 0.3362311721, 0.3718845248, 1])
graph_mapper_3 = GraphMapper(
    remap_numbers_3.Mapped,
    x0=0,
    x1=1,
    y0=0,
    y1=1,
    container_name="Bezier",
    cpx=[0, 0.4937075078, 0.5298550129, 1],
    cpy=[0.9360669851, 0.5387688279, 0.3568097353, 0.02899259329])
graph_mapper_4 = GraphMapper(
    remap_numbers_5.Mapped,
    x0=0,
    x1=1,
    y0=0,
    y1=1,
    container_name="Bezier",
    cpx=[0, 0.09710162878, 0.2435118109, 1],
    cpy=[0, 0.3652166724, 0.731316328, 1])
remap_numbers_6 = RemapNumbers(Value=vector_2pt.Length, Source=construct_domain_5, Target=Domain(0, 1))  # -> Mapped, Clipped
unit_z = UnitZ(Factor=remap_numbers_4.Mapped)
curve_closest_point_2 = CurveClosestPoint(Point=populate_3d, Curve=curve_9)  # -> Point, Parameter, Distance
construct_domain_6 = ConstructDomain(DomainStart=Slider(0, range=0..10), DomainEnd=Slider(10.77, range=0..20))
bounds_5 = Bounds(Numbers=graph_mapper_2)
unit_z_2 = UnitZ(Factor=graph_mapper_3)

# ----
# Split LineGrid into
# 2 different groups
panel_3 = Panel("{(1,3,...)}")
split_tree = SplitTree(Data=tween_curve_4, Masks=flatten(panel_3))  # -> Positive, Negative

graph_mapper_5 = GraphMapper(
    remap_numbers_6.Clipped,
    x0=0,
    x1=1,
    y0=0,
    y1=1,
    container_name="Bezier",
    cpx=[0, 0, 0.7305784822, 1],
    cpy=[1, 0.7157063484, 0, 0])
data_4 = Data(flatten(hexagonal.Cells))
smaller_than = SmallerThan(FirstNumber=graph_mapper_4, SecondNumber=random)  # -> SmallerThan, OrEqualTo
extrude = Extrude(Base=boundary_surfaces, Direction=unit_z)
deconstruct_domain_2 = DeconstructDomain(Domain=bounds_5)  # -> Start, End
scale = Scale(Geometry=offset_curve_2, Center=area.Centroid, Factor=graph_mapper_2)  # -> Geometry, Transform

# ----
# C
panel_4 = Panel(" 0")
cull_index = CullIndex(List=divide_curve_2.Points, Indices=panel_4, Wrap=True)

multiplication_3 = Multiplication(A=unit_z_2, B=Slider(2, range=0..10))
multiplication_4 = Multiplication(A=graph_mapper_5, B=attractor_multiplicator)
remap_numbers_7 = RemapNumbers(Value=curve_closest_point_2.Distance, Source=construct_domain_6, Target=Domain(0, 1))  # -> Mapped, Clipped

# ----
# A & D
cull_index_2 = CullIndex(List=divide_curve.Points, Indices=division_vertical, Wrap=True)

# ----
# B
cull_index_3 = CullIndex(List=divide_curve_2.Points, Indices=division_vertical, Wrap=True)

random_2 = Random(Range=Domain(0, 1), Number=number_slider_3, Seed=Slider(7, range=0..10))

# ----
# Curstom Preview
gradient = Gradient(
    LowerLimit=extrusion_h_min,
    UpperLimit=extrusion_h_max,
    Parameter=remap_numbers_4.Mapped,
    stops=[0: RGB(120, 243, 8), 0.421: RGB(255, 0, 0), 1: RGB(0, 255, 255)])
custom_preview = CustomPreview(Geometry=extrude, Shader=gradient)

# ----
# Circles Up
z_height = Slider(4, range=0..10)
circle_cnr = CircleCNR(Center=rectangular.Points, Normal=Vector(0, 0, 1), Radius=remap_numbers_2.Mapped)
unit_z_3 = UnitZ(Factor=z_height)
move_2 = Move(Geometry=circle_cnr, Motion=unit_z_3)  # -> graft(Geometry), Transform

graph_mapper_6 = GraphMapper(
    remap_numbers_7.Mapped,
    x0=0,
    x1=1,
    y0=0,
    y1=1,
    container_name="Bezier",
    cpx=[0, 0.2253046483, 0.3593343198, 1],
    cpy=[0, 0.462565124, 0.7976374626, 1])

# ----
# Delete unused lines
# for this pattern
panel_5 = Panel("""1
0""")
panel_6 = Panel("""0
1""")
# Curves B
cull_pattern = CullPattern(List=split_tree.Positive, CullPattern=panel_6)
# Curves A
cull_pattern_2 = CullPattern(List=split_tree.Negative, CullPattern=panel_5)

cull_pattern_3 = CullPattern(List=populate_2d_2, CullPattern=smaller_than.SmallerThan)
amplitude = Amplitude(Vector=vector_2pt.Vector, Amplitude=multiplication_4)

# ----
# Circles Down
circle_cnr_2 = CircleCNR(Center=rectangular.Points, Normal=Vector(0, 0, 1), Radius=maximum_circle_size)  # -> graft(Circle)

# ----
# Points for each elements
# for this pattern
panel_7 = Panel("4")
multiplication_5 = Multiplication(A=element_count, B=panel_7)

voronoi_2 = Voronoi(Points=cull_pattern_3, Boundary=rectangle_2.Rectangle, BruteForceOverride=False)
move_3 = Move(Geometry=scale.Geometry, Motion=multiplication_3)  # -> simplify(graft(Geometry)), Transform
mass_addition = MassAddition(Input=amplitude)  # -> Result, PartialResults
smaller_than_2 = SmallerThan(FirstNumber=graph_mapper_6, SecondNumber=random_2)  # -> SmallerThan, OrEqualTo

# ----
# E
list_item = ListItem(List=divide_curve.Points, Index=division_vertical, Wrap=True)

# ----
# F
list_item_2 = ListItem(List=divide_curve_2.Points, Index=division_vertical, Wrap=True)

# ----
# Sort Points
# 10
# 2
# C
# 6
# PointsB
# 7
# 3
# 11
# 9
# 5
# 1
# 13
# 4
# 8
# 12
# PointsA
# D
panel_8 = Panel("""0
1
2
3""")
# B
# A
weave_3 = Weave(Pattern=panel_8, Stream0=cull_index_2, Stream1=cull_index_3, Stream2=cull_index, Stream3=cull_index_2, NullGaps=False)
# F
# E
data_5 = Data(simplify(weave_3))
merge_3 = Merge(Data1=data_5, Data2=list_item, Data3=list_item_2)

data_6 = Data(simplify(graft(data_4)))
move_4 = Move(Geometry=c_script.PreviewPath, Motion=expr("-x", Y))  # -> Geometry, Transform
boundary_surfaces_2 = BoundarySurfaces(Edges=voronoi_2)
area_2 = Area(Geometry=voronoi_2)  # -> Area, Centroid
move_5 = Move(Geometry=point_4, Motion=mass_addition.Result)  # -> Geometry, Transform
merge_4 = Merge(Data1=data_6, Data2=move_3.Geometry)
addition = Addition(A=u_count, B=" 1")
addition_2 = Addition(A=v_count, B=" 1")
cull_pattern_4 = CullPattern(List=populate_3d, CullPattern=smaller_than_2.SmallerThan)

# ----
# Construct PointGrid from LineGrid
# Tip:: Curves A and B have different Cull Pattern!
# Points B
# Points A
divide_curve_3 = DivideCurve(Curve=cull_pattern, Count=expr("x-1", multiplication_5), Kinks=False)  # -> Points, Tangents, Parameters
divide_curve_4 = DivideCurve(Curve=cull_pattern_2, Count=expr("x-1", multiplication_5), Kinks=False)  # -> Points, Tangents, Parameters
panel_9 = Panel("""1
0
0
1""")
panel_10 = Panel("""0
1
1
0""")
cull_pattern_5 = CullPattern(List=divide_curve_3.Points, CullPattern=panel_9)
cull_pattern_6 = CullPattern(List=divide_curve_4.Points, CullPattern=panel_10)

loft_4 = Loft(Curves=merge_4, Options={Adjust=False, Closed=False, LoftEnds=0, LoftSimp=0, LoftType=3, Rebuild=10, Refit=0.01})  # -> flatten(Loft)
bounds_6 = Bounds(Numbers=area_2.Area)
data_7 = Data(flatten(move_5.Geometry))
remap_numbers_8 = RemapNumbers(Value=area_2.Area, Source=bounds_6, Target=Domain(0, 1))  # -> Mapped, Clipped

# ----
# Create cylinders
merge_5 = Merge(Data1=circle_cnr_2, Data2=move_2.Geometry)
loft_5 = Loft(Curves=merge_5, Options={Adjust=False, Closed=False, LoftEnds=0, LoftSimp=0, LoftType=0, Rebuild=10, Refit=0.01})
cap_holes = CapHoles(Brep=loft_5)  # -> flatten(Brep)

gradient_2 = Gradient(
    LowerLimit=deconstruct_domain_2.Start,
    UpperLimit=deconstruct_domain_2.End,
    Parameter=graph_mapper_2,
    stops=[0.00227: RGB(0, 0, 0), 0.323: RGB(255, 255, 255)])

# ----
# Reverse every second branch
# Layer 1
# Layer 1
# Layer 0
# Layer 0
# Data
# Positive result
# Negative result
panel_11 = Panel("{(1,3,...)}")
split_tree_2 = SplitTree(Data=merge_3, Masks=panel_11)  # -> Positive, Negative
reverse_list = ReverseList(List=split_tree_2.Positive)
param_viewer_4 = ParamViewer(merge_3)
param_viewer_5 = ParamViewer(split_tree_2.Positive)
param_viewer_6 = ParamViewer(split_tree_2.Negative)
merge_6 = Merge(Data1=reverse_list, Data2=split_tree_2.Negative)  # -> flatten(Result)

ghpython_script = GhPythonScript(points=data_7, srfCount=" 2", division=addition, curveLength=addition_2)  # -> out, curves; inputs points: list of Point3d, srfCount: Int32, division: Int32, curveLength: Int32
# ---------- ghpython_script: Python ----------
import rhinoscriptsyntax as rs

length = len(points)

crvList = []



for l in range(srfCount):
    srfStart =  int( length /2 * l)
    for d in range(division):
        crvPts = []
        for i in range(curveLength):
            pt = points[ srfStart + d*curveLength+i]
            crvPts.append(pt)
        crv = rs.AddInterpCurve(crvPts)
        crvList.append(crv)

curves = crvList
# ---------- end ghpython_script ----------
graph_mapper_7 = GraphMapper(
    remap_numbers_8.Mapped,
    x0=0,
    x1=1,
    y0=0,
    y1=1,
    container_name="Bezier",
    cpx=[0, 0.06137836725, 0.4023844302, 1],
    cpy=[0, 0.7131311893, 0.917735219, 1])
voronoi_3d = Voronoi3D(Points=cull_pattern_4, Box=brep_join.Breps)  # -> graft(Cells), Boundary
list_length = ListLength(List=ghpython_script.curves)
custom_preview_2 = CustomPreview(Geometry=loft_4, Material=gradient_2)
division_2 = Division(A=list_length, B=" 2")
unit_z_4 = UnitZ(Factor=graph_mapper_7)
gradient_3 = Gradient(
    LowerLimit=0,
    UpperLimit=1,
    Parameter=graph_mapper_7,
    stops=[0: RGB(243, 57, 0), 0.1: RGB(236, 27, 60), 0.2: RGB(210, 0, 118), 0.3: RGB(103, 0, 120), 0.4: RGB(39, 72, 161), 0.5: RGB(1, 192, 229), 0.6: RGB(18, 178, 90), 0.7: RGB(79, 186, 8), 0.8: RGB(220, 237, 32), 0.9: RGB(247, 159, 20), 1: RGB(243, 57, 0)])

# ----
# Custom Preview
gradient_4 = Gradient(
    LowerLimit=minimum_circle_size,
    UpperLimit=maximum_circle_size,
    Parameter=remap_numbers_2.Mapped,
    stops=[0: RGB(0, 255, 255), 1: RGB(255, 0, 255)])
custom_preview_3 = CustomPreview(Geometry=cap_holes, Material=gradient_4)

solid_intersection = SolidIntersection(BrepsA=voronoi_3d.Cells, BrepsB=brep_join.Breps)
split_list = SplitList(List=ghpython_script.curves, Index=division_2)  # -> graft(ListA), graft(ListB)
extrude_2 = Extrude(Base=boundary_surfaces_2, Direction=unit_z_4)
clean_tree = CleanTree(RemoveNulls=True, RemoveInvalid=True, RemoveEmpty=True, Tree=solid_intersection)  # -> simplify(Tree)
loft_6 = Loft(
    Curves=[split_list.ListA, split_list.ListB],
    Options={Adjust=False, Closed=False, LoftEnds=0, LoftSimp=0, LoftType=0, Rebuild=10, Refit=0.01})
custom_preview_4 = CustomPreview(Geometry=extrude_2, Material=gradient_3)
create_material = CreateMaterial(Diffuse=RGB(255, 201, 23), Specular=RGB(56, 255, 46), Emission=RGB(255, 0, 0), Transparency=0, Shine=0)

# ----
# Robot Path Simulation
polyline = PolyLine(Vertices=merge_6, Closed=False)  # -> reparameterize(Polyline)
point_on_curve = PointOnCurve(polyline, parameter=0.405)

# ----
# Path of the
# last column
# 00X
# 00X
# 00X
panel_12 = Panel(" 2")
panel_13 = Panel(division_horizontal_2)
division_3 = Division(A=panel_13, B=panel_12)
panel_14 = Panel(division_3)
concatenate = Concatenate(A=" {?;", B=panel_14, C="}")
panel_15 = Panel(concatenate)

volume = Volume(Geometry=clean_tree)  # -> Volume, Centroid
custom_preview_5 = CustomPreview(Geometry=loft_6, Material=create_material)

# ----
# Path of the
# last row
# XXX
# 000
# 000
panel_16 = Panel(" {")
panel_17 = Panel(division_vertical_2)
concatenate_2 = Concatenate(A=panel_16, B=panel_17, C=";?}")
panel_18 = Panel(concatenate_2)

bounds_7 = Bounds(Numbers=flatten(volume.Volume))
remap_numbers_9 = RemapNumbers(Value=volume.Volume, Source=bounds_7, Target=Domain(0, 1))  # -> Mapped, Clipped
deconstruct_domain_3 = DeconstructDomain(Domain=bounds_7)  # -> Start, End
graph_mapper_8 = GraphMapper(
    remap_numbers_9.Mapped,
    x0=0,
    x1=1,
    y0=0,
    y1=1,
    container_name="Bezier",
    cpx=[0, 0.3712317348, 0.6253166795, 1],
    cpy=[0.2656957507, 0.6342737675, 0.4381970167, 0.7587430477])

# ----
# X00
# X00
# XXX
panel_19 = Panel("""{0;?}
{?;0}""")

# ----
# X00
# X00
# X00
panel_20 = Panel("{?;0}")

# ----
# 000
# 000
# XXX
panel_21 = Panel("{0;?}")

gradient_5 = Gradient(
    LowerLimit=deconstruct_domain_3.Start,
    UpperLimit=deconstruct_domain_3.End,
    Parameter=volume.Volume,
    stops=[0: RGB(0, 0, 0), 0.236: RGB(0, 255, 255), 0.701: RGB(255, 255, 255)])

# ----
# 0XX
# 0XX
# 000
split_tree_3 = SplitTree(Data=cull_pattern_6, Masks=panel_19)  # -> Positive, Negative
path_mapper = PathMapper(split_tree_3.Negative, source="{A;B}", target="{A;B-1}")

# ----
# RowB_2
path_mapper_2 = PathMapper(cull_pattern_5, source="{A;B}", target="{A+1;B}")
panel_22 = Panel("""0
1
1
0""")
weave_4 = Weave(Pattern=panel_22, Stream0=path_mapper_2, Stream1=path_mapper, NullGaps=False)
polyline_2 = PolyLine(Vertices=weave_4, Closed=False)

create_material_2 = CreateMaterial(Diffuse=gradient_5, Specular=RGB(255, 255, 255), Emission=RGB(0, 0, 0), Transparency=graph_mapper_8, Shine=0)
custom_preview_6 = CustomPreview(Geometry=clean_tree, Material=create_material_2)

# ----
# Tree, Branches and Paths
# Split Tree Mask Rules: The following rule notations are allowed:
# 
# *  Any number of integers in a path
# 
# ?  Any single integer
# 
# 6  Any specific integer
# 
# !6  Anything except a specific integer
# 
# (2,6,7)  Any one of the specific integers in this group.
# 
# !(2,6,7)  Anything except one of the integers in this group.
# 
# (2 to 20)  Any integer in this range (including both 2 and 20).
# 
# !(2 to 20) Any integer outside this range.
# 
# (0,2,...)  Any integer part of this infinite sequence. Sequences have to be at least two integers long, and every subsequent integer has to be bigger than the previous one
# 
# (0,2,...,48)  Any integer part of this finite sequence. You can optionally provide a single sequence limit after the three dots.
# 
# !(3,5,...)  Any integer not part of this infinite sequence. The sequence doesn't extend to the left, only towards the right. So this rule would select the numbers 0, 1, 2, 4, 6, 8, 10, 12 and all remaining even numbers.
# 
# !(7,10,21,...,425)  Any integer not part of this finite sequence.
# 
# Source: https://www.grasshopper3d.com/forum/topics/datatree-selection-rules?page=6&commentId=2985220%3AComment%3A1888369&x=1#2985220Comment1888369
# Tip:: The BranchViewer is a halpful Cluster Component to view your Branches.
# With Edit -> Cluster you can easily build your own custom components
panel_23 = Panel("""A
B
C
D
E
F""")
panel_24 = Panel("""F
G
H""")
panel_25 = Panel("""O
P
Q""")
panel_26 = Panel("""A
B
C""")
panel_27 = Panel("""C
D
E""")
panel_28 = Panel("""I
J
K""")
panel_29 = Panel("""L
M
N""")
flatten_tree = FlattenTree(Tree=panel_24, Path="{0;2}")
flatten_tree_2 = FlattenTree(Tree=panel_25, Path="{1;2}")
flatten_tree_3 = FlattenTree(Tree=panel_26, Path="{0;0}")
flatten_tree_4 = FlattenTree(Tree=panel_27, Path="{0;1}")
flatten_tree_5 = FlattenTree(Tree=panel_28, Path="{1;0}")
flatten_tree_6 = FlattenTree(Tree=panel_29, Path="{1;1}")
data_8 = Data(graft(panel_23))
index = Slider(0, range=0..10)
branchviewer = BranchViewer(data=data_8, index=index)  # -> branch, path_2
param_viewer_7 = ParamViewer(data_8)
merge_7 = Merge(
    Data1=flatten_tree_3,
    Data2=flatten_tree_4,
    Data3=flatten_tree,
    Data4=flatten_tree_5,
    Data5=flatten_tree_6,
    Data6=flatten_tree_2)
panel_30 = Panel(branchviewer.branch)
panel_31 = Panel(branchviewer.path_2)
data_9 = Data(graft(merge_7))
data_10 = Data(flatten(merge_7))
data_11 = Data(simplify(graft(data_10)))

# ----
# {X;X;X}
index_2 = Slider(1, range=0..2)
param_viewer_8 = ParamViewer(data_9)
param_viewer_9 = ParamViewer(data_9)
panel_32 = Panel(data_9)
concatenate_3 = Concatenate(Fragment_A="{?;", Fragment_B=index_2, Fragment_C=";?}")
panel_33 = Panel(concatenate_3)
split_tree_4 = SplitTree(Data=data_9, Masks="{?;0;?}")  # -> Positive, Negative
split_tree_5 = SplitTree(Data=data_9, Masks=["{?;0;?}", "{?;1;?}"])  # -> Positive, Negative
split_tree_6 = SplitTree(Data=data_9, Masks=panel_33)  # -> Positive, Negative
positive = Panel(split_tree_4.Positive)
negative = Panel(split_tree_4.Negative)
positive_2 = Panel(split_tree_5.Positive)
negative_2 = Panel(split_tree_5.Negative)
positive_3 = Panel(split_tree_6.Positive)
negative_3 = Panel(split_tree_6.Negative)

# ----
# {X}
param_viewer_10 = ParamViewer(data_11)
param_viewer_11 = ParamViewer(data_11)
panel_34 = Panel(data_11)
split_tree_7 = SplitTree(Data=data_11, Masks="{(1,3,...)}")  # -> Positive, Negative
split_tree_8 = SplitTree(Data=data_11, Masks="{(1 to 2)}")  # -> Positive, Negative
split_tree_9 = SplitTree(Data=data_11, Masks="{(0,2)}")  # -> Positive, Negative
positive_4 = Panel(split_tree_9.Positive)
negative_4 = Panel(split_tree_9.Negative)
param_viewer_12 = ParamViewer(split_tree_7.Positive)
positive_5 = Panel(split_tree_7.Positive)
param_viewer_13 = ParamViewer(split_tree_7.Negative)
negative_5 = Panel(split_tree_7.Negative)
positive_6 = Panel(split_tree_8.Positive)
negative_6 = Panel(split_tree_8.Negative)

param_viewer_14 = ParamViewer(data_10)
param_viewer_15 = ParamViewer(data_10)
panel_35 = Panel(data_10)

# ----
# {X;X}
panel_36 = Panel(merge_7)
param_viewer_16 = ParamViewer(merge_7)
param_viewer_17 = ParamViewer(merge_7)
split_tree_10 = SplitTree(Data=merge_7, Masks="{1;?}")  # -> Positive, Negative
split_tree_11 = SplitTree(Data=merge_7, Masks="{?;(1 to 2)} ")  # -> Positive, Negative
split_tree_12 = SplitTree(Data=merge_7, Masks="{?;(0,2,...)}")  # -> Positive, Negative
positive_7 = Panel(split_tree_10.Positive)
negative_7 = Panel(split_tree_10.Negative)
positive_8 = Panel(split_tree_11.Positive)
negative_8 = Panel(split_tree_11.Negative)
positive_9 = Panel(split_tree_12.Positive)
negative_9 = Panel(split_tree_12.Negative)

# ----
# Darstellung Gestell
crv_4 = Curve(crv)
crv_5 = Curve(crv_2)
crv_6 = Curve(crv_3)
divide = DivideCurve(Curve=crv_4, Count=number_slider_7, Kinks=False)  # -> Points, Tangents, Parameters
divide_2 = DivideCurve(Curve=crv_5, Count=number_slider_7, Kinks=False)  # -> Points, Tangents, Parameters
area_3 = Area(Geometry=crv_4)  # -> Area, Centroid
area_4 = Area(Geometry=crv_5)  # -> Area, Centroid
area_5 = Area(Geometry=crv_6)  # -> Area, Centroid
divide_3 = DivideCurve(Curve=crv_6, Count=number_slider_7, Kinks=False)  # -> Points, Tangents, Parameters
pt_3 = Point(flatten(divide.Points))
pt_4 = Point(flatten(divide_2.Points))
pt_5 = Point(flatten(divide_3.Points))
path_mapper_3 = PathMapper(pt_4, source="{A}", target="{A+1}")
path_mapper_4 = PathMapper(pt_5, source="{A}", target="{A+2}")
merge_8 = Merge(Data1=crv_4, Data2=crv_5, Data3=crv_6)
merge_9 = Merge(Data1=pt_3, Data2=path_mapper_3, Data3=path_mapper_4)
merge_10 = Merge(Data1=area_3.Centroid, Data2=area_4.Centroid, Data3=area_5.Centroid)  # -> simplify(graft(Result))
number_slider_8 = Slider(0.103, range=0..1)
moveaway = MoveAwayFrom(Geometry=merge_9, Emitter=merge_10, Distance=Slider(0.14, range=0..1))  # -> Geometry, Transform
vec2pt = Vector2Pt(PointA=merge_9, PointB=moveaway.Geometry, Unitize=False)  # -> Vector, Length
offset = OffsetCurve(Curve=merge_8, Distance=expr("-x", Slider(0.163, range=0..1)), Plane=PlaneXY(0, 0, 0), Corners=1)
circle = CircleCNR(Center=merge_9, Normal=vec2pt.Vector, Radius=number_slider_8)
pipe_2 = Pipe(Curve=offset, Radius=number_slider_8, Caps=0)
extr = Extrude(Base=circle, Direction=vec2pt.Vector)
circle_2 = CircleCNR(Center=moveaway.Geometry, Normal=vec2pt.Vector, Radius=Slider(0.129, range=0..1))
vec = Vector(unitize(vec2pt.Vector))

division_4 = Division(A=vec, B=Slider(9, range=0..10))

extr_2 = Extrude(Base=circle_2, Direction=division_4)
cap = CapHoles(Brep=extr_2)
merge_11 = Merge(Data1=pipe_2, Data2=extr, Data3=cap)
preview_2 = CustomPreview(Geometry=merge_11, Material=ColourSwatch(SwatchColor=RGB(130, 130, 130)))

# ----
# Before
# RowA_1
# After
merge_12 = Merge(Data1=panel_18, Data2=panel_15)
result = Panel(merge_12)
path_mapper_5 = PathMapper(cull_pattern_5, source="{A;B}", target="{A-1;B}")
param_viewer_18 = ParamViewer(cull_pattern_5)
panel_37 = Panel("""0
1
1
0""")
param_viewer_19 = ParamViewer(path_mapper_5)

# ----
# 000
# XX0
# XX0
split_tree_13 = SplitTree(Data=cull_pattern_6, Masks=result)  # -> Positive, Negative

weave_5 = Weave(Pattern=panel_37, Stream0=path_mapper_5, Stream1=split_tree_13.Negative, NullGaps=False)
polyline_3 = PolyLine(Vertices=weave_5, Closed=False)

# ----
# RowA_2
merge_13 = Merge(Data1=panel_18, Data2=panel_20)
path_mapper_6 = PathMapper(cull_pattern_5, source="{A;B}", target="{A-1;B+1}")
result_2 = Panel(merge_13)
panel_38 = Panel("""0
1
1
0""")

# ----
# 000
# 0XX
# 0XX
split_tree_14 = SplitTree(Data=cull_pattern_6, Masks=result_2)  # -> Positive, Negative

weave_6 = Weave(Pattern=panel_38, Stream0=path_mapper_6, Stream1=split_tree_14.Negative, NullGaps=False)
polyline_4 = PolyLine(Vertices=weave_6, Closed=False)

# ----
# RowB_1
merge_14 = Merge(Data1=panel_15, Data2=panel_21)
panel_39 = Panel(merge_14)
path_mapper_7 = PathMapper(cull_pattern_5, source="{A;B}", target="{A+1;B}")
panel_40 = Panel("""0
1
1
0""")

# ----
# XX0
# XX0
# 000
split_tree_15 = SplitTree(Data=cull_pattern_6, Masks=panel_39)  # -> Positive, Negative

weave_7 = Weave(Pattern=panel_40, Stream0=path_mapper_7, Stream1=split_tree_15.Negative, NullGaps=False)
polyline_5 = PolyLine(Vertices=weave_7, Closed=False)

# ----
# Merge Data of
# 2 Rows together
# RowA
# RowB
weave_8 = Weave(Pattern=[0, 1], Stream0=polyline_3, Stream1=polyline_4, NullGaps=False)
weave_9 = Weave(Pattern=[0, 1], Stream0=polyline_5, Stream1=polyline_2, NullGaps=False)

# ----
# Adjust branch depth and merge together
param_viewer_20 = ParamViewer(weave_9)
param_viewer_21 = ParamViewer(weave_8)
path_mapper_8 = PathMapper(weave_8, source="{A;B}", target="{A}")
path_mapper_9 = PathMapper(weave_9, source="{A;B}", target="{A-1}")
merge_15 = Merge(Data1=path_mapper_8, Data2=path_mapper_9)
param_viewer_22 = ParamViewer(path_mapper_9)
param_viewer_23 = ParamViewer(path_mapper_8)
param_viewer_24 = ParamViewer(merge_15)

# ----
# Reverse every second branch
panel_41 = Panel(" {(2,3,6,7,...)}")
split_tree_16 = SplitTree(Data=merge_15, Masks=panel_41)  # -> Positive, Negative
reverse_list_2 = ReverseList(List=split_tree_16.Positive)
param_viewer_25 = ParamViewer(split_tree_16.Positive)
merge_16 = Merge(Data1=reverse_list_2, Data2=split_tree_16.Negative)

# ----
# Flip every second curve direction in each branch
# Before Graft
# After Graft
data_12 = Data(graft(merge_16))
split_tree_17 = SplitTree(Data=data_12, Masks=" {?;(0,2,...)}")  # -> Positive, Negative
param_viewer_26 = ParamViewer(data_12)
param_viewer_27 = ParamViewer(merge_16)
flip_curve = FlipCurve(Curve=split_tree_17.Negative)  # -> Curve, Flag
merge_17 = Merge(Data1=split_tree_17.Positive, Data2=flip_curve.Curve)

# ----
# Points from Curve
data_13 = Data(flatten(merge_17))
param_viewer_28 = ParamViewer(merge_17)
param_viewer_29 = ParamViewer(data_13)
join_curves = JoinCurves(Curves=data_13, Preserve=False)
control_points = ControlPoints(Curve=join_curves)  # -> Points, Weights, Knots
data_14 = Data(flatten(control_points.Points))
param_viewer_30 = ParamViewer(data_14)
param_viewer_31 = ParamViewer(control_points.Points)

# ----
# Robot Path Simulation
polyline_6 = PolyLine(Vertices=data_14, Closed=False)  # -> reparameterize(Polyline)
# Point attractors
point_on_curve_2 = PointOnCurve(polyline_6, parameter=0.131)

# ==== cluster BranchViewer
data = ClusterInput()
data_2 = Data(data)
param_viewer = ParamViewer(data_2)
index = ClusterInput()
list_item = ListItem(List=param_viewer, Index=index, Wrap=True)
tree_branch = TreeBranch(Tree=data_2, Path=list_item, MaintainPaths=True)
path = DataPath(list_item)
branch = ClusterOutput(tree_branch)
path_2 = ClusterOutput(path)
