# Grasshopper definition 200831_Vorlage.gh (Grasshopper 1.0.7)
# plug-ins: Robots, Monolith

number_slider = Slider(200, range=0..1000)
# General Notes: By Andy Payne and Panagiotis Michalatos
# Last Modified 11/16/2015
# 
# All Rights Reserved
# Tested with Grasshopper Build 0.9.0076
# For more information, visit www.monolith.zone
# License: This work is licensed under a Creative Commons Attribution 3.0 licence. You are free to copy, communicate and adapt the work, so long as you attribute the work in the manner specified by the author or licensor (but not in any way that suggests that they endorse you or your use of the work).
# A copy of this licence is available at http://http://creativecommons.org/licenses/by/3.0/ or write to info@creativecommons.org
number_slider_2 = Slider(550, range=0..1000)
height = Slider(30, range=0..100)
addition = Addition(A=height, B=number_slider)
construct_point = ConstructPoint(XCoordinate=number_slider_2, YCoordinate=expr("-x", Slider(150, range=0..1000)), ZCoordinate=addition)
# Bitmap Sources and Image Lofting: Bitmap Sources are the most primitive way to define an image pattern to modify the voxel field.  In essence, the Bitmap Source simply defines the image path and the channel to sample (i.e. red, green, blue, brightness, saturation, etc). The Add or Multiply Sources component will iterate through the voxel field and sample the image for the specified channel and add/multiply it with the base value.  How a bitmap source is oriented/mapped in three dimensions can be modified using one of the other image-based components (i.e. Image Loft or Image Blend).
# The Image Loft component creates an interpolation between images stacked along the Z axis. You can add as many Bitmap Sources to the image input and it will interpolate between them using the Z-axis normalized values (i.e. 0-1).  Note, the list order in which you add the bitmaps and Z-axis locations is important.
center_box = CenterBox(Base=construct_point, X=number_slider, Y=number_slider, Z=number_slider)

# ----
# Frame
length_in_mm = Slider(450, range=0..1000)
vector_xyz = VectorXYZ(XComponent=expr("-x/2", length_in_mm), YComponent=expr("-x/2", length_in_mm), ZComponent=expr("-x", addition))  # -> Vector, Length
move = Move(Geometry=construct_point, Motion=vector_xyz.Vector)  # -> Geometry, Transform
rectangle = Rectangle(Plane=move.Geometry, XSize=length_in_mm, YSize=length_in_mm, Radius=0)  # -> Rectangle, Length

# ----
# 02_Monolith_Cross_02.jpg
number_slider_3 = Slider(1, range=-1..1)
path = FilePath("C:\Users\Leon Brohmann\Downloads\monolith_examples\X.jpeg")
img_source = ConstructImageSource(ImagePath=path, Channel=6, Strength=number_slider_3)

# ----
# right-click to
# set image path
# 02_Monolith_Cross_01.jpg
number_slider_4 = Slider(1, range=-1..1)
path_2 = FilePath("C:\Users\Leon Brohmann\Downloads\monolith_examples\Cross.jpeg")
img_source_2 = ConstructImageSource(ImagePath=path_2, Channel=6, Strength=number_slider_4)

# ----
# 02_Monolith_Ring_01.jpg
number_slider_5 = Slider(0.85, range=-1..1)
path_3 = FilePath("C:\Users\Leon Brohmann\Downloads\monolith_examples\Circle.jpeg")
img_source_3 = ConstructImageSource(ImagePath=path_3, Channel=6, Strength=number_slider_5)

path_4 = FilePath("C:\Users\Leon Brohmann\Downloads\monolith_examples\Circle.jpeg")

# ----
# 02_Monolith_Circle_01.jpg
number_slider_6 = Slider(1, range=-1..1)
img_source_4 = ConstructImageSource(ImagePath=path_4, Channel=6, Strength=number_slider_6)

# ----
# Create a Voxel Field: To start, you must first create a voxel field which defines the boundary, the voxel resolution, and the channel configuration.  Note, that in this example we have overridden the default channel configuration such that the base voxel field has four channels (Shape, Red, Green, and Blue).
panel = Panel("3")
create_voxels = ConstructBaseVoxels(Box=center_box, Resolution=48, BaseChannelTypes=panel, Fill=0)

bitmap_loft = BitmapLoft(
    BitmapSources=[img_source_2, img_source_3, img_source],
    Locations=[Slider(0.1, range=0..1), Slider(0.5, range=0..1), Slider(0.9, range=0..1)])

# ----
# Image Blending: The Image Blend component extrudes and combines three images along each of the XYZ axes. In the example below, a simple radial gradient is blended along each of the orthographic directions which then specifies one of the Red, Green, or Blue channels of the voxel field.
bitmap_blend = BitmapBlend(XY=img_source_4, YZ=img_source_4)
bitmap_blend_2 = BitmapBlend(YZ=img_source_4, ZX=img_source_4)
bitmap_blend_3 = BitmapBlend(XY=img_source_4, ZX=img_source_4)

# ----
# Add/Multiply Sources: Here we simply add the sources together and then extract the iso-surface.  Note, we can use a single numeric value for the isosurface threshold, or a domain between two values (as in the example below).
add_sources = AddSources(
    Voxels=create_voxels,
    Shape=flatten(bitmap_loft),
    Red=flatten(bitmap_blend),
    Green=flatten(bitmap_blend_2),
    Blue=flatten(bitmap_blend_3),
    variables="Shape,Red,Green,Blue")
get_channels = GetChannelNames(Voxels=add_sources, variables="Shape,Red,Green,Blue")  # -> Shape, Red, Green, Blue
iso_mesh = GetIsoMesh(Voxels=add_sources, Channel=get_channels.Shape, IsoValue=Slider(0.799, range=0..1), CapEdgeFaces=False)

c_preview = CSharpScript(pLine=rectangle.Rectangle, width=3)  # inputs pLine: tree of Curve, width: Int32
# ---------- c_preview: C# ----------
    preview = pLine.AllData();
    _width = width;
# ---------- c_preview: C# additional code ----------
  List< Curve> preview = new List< Curve>();
  int _width;

  public override void DrawViewportMeshes(IGH_PreviewArgs args)
  {
    if (preview.Count != 0)
    {

      foreach (var item in preview)
      {
        args.Display.DrawCurve(item, System.Drawing.Color.Red, _width);
      }

    }


  }
# ---------- end c_preview ----------

# ----
# Coloring the Mesh by RGB Channels: There are two Mesh Coloring components, one of which allows you to use a voxel channel to specify the Red, Green, and Blue color values of a mesh.  In this example, we have use an Image Blend component to interpolate a radial gradient along the XYZ axis.
color_mesh = ColorMeshByRGB(Voxels=add_sources, Mesh=iso_mesh, Red=get_channels.Red, Green=get_channels.Green, Blue=get_channels.Blue)

# ----
# Get StartPt
box = Box(color_mesh)
deconstruct_box = DeconstructBox(Box=box)  # -> Plane, X, Y, Z
deconstruct_domain = DeconstructDomain(Domain=deconstruct_box.Z)  # -> Start, End
construct_point_2 = ConstructPoint(XCoordinate=0, YCoordinate=0, ZCoordinate=deconstruct_domain.Start)

# ----
# LayerHeight
number_slider_7 = Slider(8, range=8..1000)

# ----
# Smooth Curves
# Maker shorter,
# when curve closed
# Get Pts
contour = Contour(Shape=color_mesh, Point=construct_point_2, Direction=Vector(0, 0, 1), Distance=number_slider_7)
c_preview_2 = CSharpScript(pLine=contour, width=1)  # inputs pLine: tree of Curve, width: Int32
# ---------- c_preview_2: C# ----------
    preview = pLine.AllData();
    _width = width;
# ---------- c_preview_2: C# additional code ----------
  List< Curve> preview = new List< Curve>();
  int _width;

  public override void DrawViewportMeshes(IGH_PreviewArgs args)
  {
    if (preview.Count != 0)
    {

      foreach (var item in preview)
      {
        args.Display.DrawCurve(item, System.Drawing.Color.Cyan, _width);
      }

    }


  }
# ---------- end c_preview_2 ----------
rebuild_curve = RebuildCurve(Curve=contour, Degree=" 3", Count=39, Tangents=False)  # -> reparameterize(Curve)
c_make_short = CSharpScript(crv=rebuild_curve, makeShorter=Slider(0, range=0..30))  # -> out, Crv, A; inputs crv: Curve, makeShorter: Double
# ---------- c_make_short: C# ----------
    Crv = crv;



    if (!crv.IsClosed)
      return;

    double length = crv.GetLength();

    double paramToCut = 1.00 / length * makeShorter;
    A = paramToCut;

    if (paramToCut <= 0)
      paramToCut = 0.001;

    crv = crv.Trim(0.00, 1.00 - paramToCut);


    Crv = crv;
# ---------- end c_make_short ----------
distancebetween = Slider(20, range=10..30)
curve = Curve(reparameterize(c_make_short.Crv))
c_get_pts = CSharpScript(crv=curve, distance=distancebetween)  # -> out, simplify(Pts); inputs crv: Curve, distance: Int32
# ---------- c_get_pts: C# ----------
    List<Point3d> pts = new List<Point3d>();

    double length = crv.GetLength();
    double countD = length / distance;

    int count = Convert.ToInt32(countD);
    
    if (count == 0)
    {
      pts.Add(crv.PointAtStart);
      pts.Add(crv.PointAtEnd);
    }
    else
    {
      Point3d[] ptArr = new Point3d[0];

      crv.DivideByCount(count, true, out ptArr);
      pts.AddRange(ptArr);
    }

    Pts = pts;
# ---------- end c_get_pts ----------

# ----
# Set Layer
setlayer = Slider(21, range=0..48)
concatenate = Concatenate(Fragment_A="{", Fragment_B=setlayer, A=";?}")

# ----
# Path Planning
# Roboter Positionen
# Start
# End
# COMMANDS ( Extruder AN/AUS)
split_tree = SplitTree(Data=c_get_pts.Pts, Masks=flatten(concatenate))  # -> Positive, Negative
list_item = ListItem(List=split_tree.Positive, Index=0, Wrap=True)  # -> Item1, Item
unit_z = UnitZ(Factor=Slider(30, range=0..100))
move_2 = Move(Geometry=list_item.Item, Motion=unit_z)  # -> Geometry, Transform
move_3 = Move(Geometry=list_item.Item1, Motion=unit_z)  # -> Geometry, Transform

# ----
# List Count
list_length = ListLength(List=split_tree.Positive)

# ----
# Extruder ON
panel_2 = Panel("TRUE")
set_do = SetDO(DO=7, Value=panel_2)

# ----
# Extruder OFF
panel_3 = Panel("FALSE")
set_do_2 = SetDO(DO=7, Value=panel_3)

# ----
# Branch Count
param_viewer = ParamViewer(list_length)
list_length_2 = ListLength(List=param_viewer)

# ----
# Extruder ON
# For each object
repeat_data = RepeatData(Data=set_do, Length=expr("x-1", simplify(list_length)))  # -> simplify(Data)

# ----
# Extruder OFF
# For each object
repeat_data_2 = RepeatData(Data=set_do_2, Length=simplify(list_length_2))  # -> simplify(graft(Data))

merge = Merge(Data1=repeat_data_2, Data2=repeat_data, Data3=repeat_data_2, Data4=repeat_data_2)  # -> flatten(Result)
merge_2 = Merge(Data1=set_do_2, Data2=merge, Data3=set_do_2)

# ----
# Tool Definition
length = Slider(60, range=0..130)
distance = Slider(5, range=0..130)
mesh = Mesh(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)
c_gettcp = CSharpScript(mesh=mesh, nozzleLength=length, distance=distance)  # -> TCP, MeshNozzle; inputs mesh: Mesh, nozzleLength: Double, distance: Double
# ---------- c_gettcp: C# ----------
    BoundingBox bBox = mesh.GetBoundingBox(false);

    Point3d nozzlePt = new Point3d(17.712729, -99.103086, 39.0);

    Plane pn = new Plane(nozzlePt, -Vector3d.YAxis);

    Cylinder c = new Cylinder(new Circle(pn, 5.25), nozzleLength);
    Mesh mC = Mesh.CreateFromCylinder(c, 1, 8);

    mC.Append(mesh);

    Plane pl = new Plane(new Point3d(nozzlePt.X, (nozzlePt.Y - nozzleLength - distance), nozzlePt.Z), Vector3d.ZAxis);


    TCP = pl;
    MeshNozzle = mC;
# ---------- end c_gettcp ----------
create_tool = CreateTool(ExtruderLance="windingTool", TCP=c_gettcp.TCP, Weight=0, Mesh=c_gettcp.MeshNozzle)  # -> Tool, TCP

# ----
# General Notes: Autor: Leon Brohmann, Stefan Gantner
# ITE 2020
# Robot
command = Data(merge_2)
control_knob = ControlKnob(Decimals=3, Limit=True, Maximum=1, Minimum=0, Range=1, Value=0.803)

# ----
# Speed
# HomingSpeed
speed = Slider(1500, range=300..10000)
homespeed = Slider(1000, range=0..1000)

# ----
# Robot System
value_list = ValueList({"UR 10 Tisch": 0, "UR 5 Tisch": 1, "UR 5 Tisch außen": 2}, selected="UR 10 Tisch")
c_robotpos = CSharpScript(UR=value_list, TooltipTextOverride="Author: Leon Brohmann")  # -> Name, BasePlane, IpAddress; inputs UR: Int32
# ---------- c_robotpos: C# ----------
    string name;
    Point3d pos;
    string ipAddress;

    switch (UR)
    {
      default:
        name = "ITE-UR10";
        ipAddress = "192.168.1.202";
        pos = Point3d.Origin;
        break;

      case 1:
        name = "ITE-UR5";
        ipAddress = "192.168.1.201";
        pos = new Point3d(0, 1110, 0);
        break;

      case 2:
        name = "ITE-UR5";
        ipAddress = "192.168.1.201";
        pos = new Point3d(0, 1700, 0);
        break;
    }

    Name = name;
    BasePlane = new Plane(pos, Vector3d.ZAxis);
    IpAddress = ipAddress;
# ---------- end c_robotpos ----------
load_robot_system = LoadRobotSystem(Name=c_robotpos.Name, Base=c_robotpos.BasePlane)

# ----
# Table
arbeitstisch = Mesh([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])
C = ColourSwatch(SwatchColor=RGB(176, 176, 176))
custom_preview = CustomPreview(Geometry=arbeitstisch, Material=C)

merge_3 = Merge(Data1=move_2.Geometry, Data2=split_tree.Positive, Data3=move_3.Geometry)  # -> flatten(Result)

# ----
# WaitPos
deconstruct = Deconstruct(Point=move.Geometry)  # -> XComponent, YComponent, ZComponent
list_item_2 = ListItem(List=merge_3, Index=0, Wrap=True)
y = Slider(156, range=0..300)
z = Slider(55, range=0..100)
deconstruct_2 = Deconstruct(Point=list_item_2)  # -> XComponent, YComponent, ZComponent
subtraction = Subtraction(A=deconstruct.YComponent, B=y)
addition_2 = Addition(A=deconstruct_2.ZComponent, B=z)
construct_point_3 = ConstructPoint(XCoordinate=deconstruct_2.XComponent, YCoordinate=subtraction, ZCoordinate=addition_2)

merge_4 = Merge(Data1=construct_point_3, Data2=merge_3, Data3=construct_point_3)
flip_plane = FlipPlane(Plane=merge_4, ReverseX=False, ReverseY=False, SwapAxes=True)  # -> flatten(Plane)
rotate_3d = Rotate3D(Geometry=flip_plane, Angle=degrees(90), Center=flip_plane, Axis=Vector(0, -1, 0))  # -> Geometry, Transform

# ----
# TargetPlanes
targetplanes = Plane(rotate_3d.Geometry)

# ----
# Roboter Target
round_movement = Slider(5, range=0..10)
flag_fields = FlagFields({"Shoulder": 1, "Elbow": 2, "Wrist": 4}, selected="Wrist")
value_list_2 = ValueList({"Joint", "Linear"}, selected="Joint")
create_target = CreateTarget(
    Plane=targetplanes,
    RobConf=flag_fields,
    Motion=value_list_2,
    Tool=create_tool.Tool,
    Speed=speed,
    Zone=round_movement,
    Command=command,
    IsCartesian=True)

# ----
# Create Roboter Programm
create_program = CreateProgram(
    Name="DefaultProgram",
    RobotSystem=load_robot_system,
    Targets1=create_target,
    StepSize=1,
    URHomingSpeed=expr("x/10", homespeed))  # -> Program, Code, Duration, Warnings, Errors, Arrays

# ----
# Robot Preview
program_simulation = ProgramSimulation(Program=create_program.Program, Time=control_knob, Normalized=True)  # -> SystemMeshes, JointRotations, Plane, Index, Time, Program, Errors
C_2 = ColourSwatch(SwatchColor=RGB(178, 178, 178))
custom_preview_2 = CustomPreview(Geometry=program_simulation.SystemMeshes, Material=C_2)

# ----
# Roboter Path Preview
number_slider_8 = Slider(2, range=0..10)
polyline = PolyLine(Vertices=targetplanes, Closed=False)  # -> reparameterize(Polyline)
c_preview_3 = CSharpScript(index=program_simulation.Index, simPlanes=program_simulation.Plane, pLine=polyline, width=number_slider_8)  # inputs index: Int32, simPlanes: list of Plane, pLine: Curve, width: Int32
# ---------- c_preview_3: C# ----------
    preview = null;
    _width = width;

    Point3d testPoint = simPlanes[7].Origin;

    double t = 0;
    pLine.ClosestPoint(testPoint, out t);

    if (t == 0)
      return;

    if (t == 1)
    {
      preview = pLine;
      return;
    }

    Curve[] crvs = pLine.Split(t);

    if (crvs == null || crvs.Length < 1)
      return;

    preview = crvs[0];
# ---------- c_preview_3: C# additional code ----------
  Curve preview;
  int _width;

  public override void DrawViewportMeshes(IGH_PreviewArgs args)
  {
    if (preview != null)
      args.Display.DrawCurve(preview, System.Drawing.Color.DarkBlue, _width);

  }
# ---------- end c_preview_3 ----------

# ----
# UR Control
play = Button()
remote_ur = RemoteUR(Program=create_program.Program, IP=c_robotpos.IpAddress, Upload=play, Play=False, Pause=False)
